# Grasshopper definition depthscanner_ghpython.gh (Grasshopper 1.0.7)
# plug-ins: Docofossor

scan = GhPythonScript(start=Toggle(False))  # -> out, df; inputs start: Boolean
# ---------- scan: Python ----------
"""Scans the sandbox using the Docofossor format
    Inputs:
        start: Start the scan
    Output:
        df: The Docofossor list"""

__author__     = ['Ilmar Hurkxkens']
__license__    = 'MIT License'
__email__      = ['hurkxkens@arch.ethz.ch']

# install the depthscanner package to use this script: 
# https://github.com/ilmihur/depthscanner.git

from compas.rpc import Proxy

if start:
    depthscanner = Proxy('depthscanner', python='C:\Users\ilmi\Anaconda3\envs\dev27\python')
    df = depthscanner.scangrid()
    Proxy.stop_server(depthscanner)
# ---------- end scan ----------

# ---- group: old
scan_2 = GhPythonScript()  # -> out, df; inputs start: Boolean, n: Int32
# ---------- scan_2: Python ----------
import compas
import compas_rhino
import rhinoscriptsyntax as rs

from compas.rpc import Proxy

if not n or n < 1:
    n = 1

if start:

    ## make the function available as a wrapped function.
    depthscanner = Proxy('depthscanner', python='C:\Users\ilmi\Anaconda3\envs\dev27\python')
    
    ## start the scan
    df = depthscanner.scangrid()
    
    ## stop the server so scan.py will be reloaded
    Proxy.stop_server(depthscanner)

    #print(len(zi))

    ## reformat z data to docofossor >>> moved to scangrid()
    #zi.reverse()
    #lz = [j for i in zi for j in i]
   
    # construct dimension list
    #nc = 640 #len(zi[0]) >>> see target grid in scangrid
    #nr = 360# len(zi) >>> see target grid in scangrid
    #ox = 0
    #oy = 0
    #cx = 1 #1*n
    #cy = 1 #1*n
    #gx = ox
    #gy = oy
    #dim = [nc,nr,ox,oy,cx,cy,0,0,gx,gy]
    
    ## filter 
    #nz = []
    #for r in range(fr):
    #    for c in range(fc):
    #        nz.append(float(zi[r*n*nc + c*n]))
    
    # construct df list
    #df = dim + zi
    
    
    
    
    
    ## convert the list to points and add to pointcloud
    #points = []
    #for i in pts:
    #    pnt = rs.CreatePoint(i[0],i[1],i[2])
    #    points.append(pnt)
    #    
    #print('Successfully captured ' + str(len(points)) + ' points.')
    #print('Line 0 =' + str(pts[0]))
# ---------- end scan_2 ----------

# ----
panel = Panel(scan.out)
grid_mesh = GridMesh(Df=scan.df)
